# Grasshopper definition AutoPanel2.gh (Grasshopper 1.0.7)
# plug-ins: ScriptParasite, EleFront, MetaHopper, Human, Heteroptera

layertable = LayerTable(Update=Button(), AutoUpdate=False)  # -> Layers, FullLayerPaths, LayerColors, Linetypes, MaterialNames, Visible, PrintWidth, PrintColor
# Da Rhino assicurarsi di avere i layer così ordinati:
# -------------------
# dir-border-h
# dir-border-v
# 
# dir-h-x.x
# ...
# dir-v-x.x
# ...
# -------------------
# i primi due sono DUE LINEE che determinano i bordi dell'area da pannellare. I bordi avranno anch'essi una fuga e andranno ridisegnati nei layer delle fughe
# 
# I layer seguenti sono tutte le fughe centrate che il codice utilizza per creare i pannelli
# -------------------
# obs-[...]
# -------------------
# gli ostacoli
python = GhPythonScript(x=layertable.Layers)  # -> a; inputs x: list
# ---------- python: Python ----------
__author__ = "riccardo"
__version__ = "2023.02.16"

import rhinoscriptsyntax as rs

list = []

for i in x:
    if (i.split('-')[0] == 'dir' and len(i) > 3):
        list.append(i)

a = list
# ---------- end python ----------
panel = Panel(python)
panel_2 = Panel("CONTROLLO MANUALE LAYERS")
panel_3 = Panel("""dir-border-h
dir-border-v
dir-h-2.2
dir-h-8.8
dir-v-8.8
dir-b-8.8.5.5""")

reflay = ReferenceByLayer(LayerName="obs-windows")

reflay_2 = ReferenceByLayer(LayerName=panel_3)
merge = Merge(Data1=graft(panel_3), Data2=reflay_2)  # -> simplify(Result)

# ---- group: GENERATOR
c_script = CSharpScript(x=merge, y=reflay)  # -> pl, names, archive, freeTag; inputs x: tree, y: list of Polyline
# ---------- c_script: C# usings ----------
using Rhino.Geometry.Intersect;
using System.Linq;
using Rhino.FileIO;
# ---------- c_script: C# ----------
    grid = new Grid(x, y);
    panelC41s = grid.panels;

    pl = grid.Plines(panelC41s);
    names = grid.NameTags(panelC41s);
    archive = Archive(panelC41s);
    freeTag = grid.FreeTag(panelC41s);
# ---------- c_script: C# additional code ----------
  // fields
  public Grid grid;
  public List<PanelC41> panelC41s;

  public List<string> archive;

  public class Grid
  {
    public DataTree<object> param;
    List<Polyline> obs;

    // tutte le coordinate delle fughe in X e Y
    public List<double> xCoordinates;
    public List<double> yCoordinates;

    public List<PanelC41> panels;
    public List<Point3d> pts;

    public Grid(DataTree<object> x, List<Polyline> y)
    {
      param = x;
      obs = y;

      OrderLines(param);

      pts = new List<Point3d>();

      panels = Panels(xCoordinates, yCoordinates);
    }

    public void OrderLines(DataTree<object> param)
    {
      List<double> xtmp = new List<double>();
      List<double> ytmp = new List<double>();

      // param.BranchCount - 1 perch� l'ultimo branch sono i bordi esterni
      for (int i = 2; i < param.BranchCount - 1; i++)
      {
        int fuga = (int)Convert.ToInt64(param.Branch(i)[0].ToString().Split('-')[2].ToString().Split('.')[0]);
        string dir = param.Branch(i)[0].ToString().Split('-')[1];

        List<double> tmp = new List<double>();

        if (dir == "h")
        {
          for (int j = 1; j < param.Branch(i).Count; j++)
          {
            PolylineCurve tmpPl = (PolylineCurve)param.Branch(i)[j];
            tmp.Add(tmpPl.PointAt(0).Y - fuga);
            tmp.Add(tmpPl.PointAt(0).Y + fuga);
          }

          ytmp.AddRange(tmp);
        }

        else if (dir == "v")
        {
          for (int j = 1; j < param.Branch(i).Count; j++)
          {
            PolylineCurve tmpPl = (PolylineCurve)param.Branch(i)[j];
            tmp.Add(tmpPl.PointAt(0).X - fuga);
            tmp.Add(tmpPl.PointAt(0).X + fuga);
          }

          xtmp.AddRange(tmp);
        }
      }

      xtmp.Sort();
      ytmp.Sort();

      xCoordinates = xtmp;
      yCoordinates = ytmp;

      Borders(param);
    }

    public List<PanelC41> Panels(List<double> xCoordinates, List<double> yCoordinates)
    {
      List<PanelC41> panels = new List<PanelC41>();

      for (int i = 0; i < yCoordinates.Count; i += 2)
      {
        for (int j = 0; j < xCoordinates.Count; j += 2)
        {
          var points = new List<Point3d>
            {
              new Point3d(xCoordinates[j], yCoordinates[i], 0),
              new Point3d(xCoordinates[j + 1], yCoordinates[i], 0),
              new Point3d(xCoordinates[j + 1], yCoordinates[i + 1], 0),
              new Point3d(xCoordinates[j], yCoordinates[i + 1], 0),
              new Point3d(xCoordinates[j], yCoordinates[i], 0)
              };

          pts.AddRange(points.GetRange(0, 4));
          panels.Add(new PanelC41(points, obs));
        }
      }

      return panels;
    }

    public List<Polyline> Plines(List<PanelC41> panels)
    {
      List<Polyline> polylines = panels.Select(i => i.pl).ToList();

      return polylines;
    }

    public List<bool> FreeTag(List<PanelC41> panels)
    {
      List<bool> freeTag = panels.Select(i => i.crossed).ToList();

      return freeTag;
    }

    public List<string> NameTags(List<PanelC41> panels)
    {
      List<string> nameTags = panels.Select(i => i.name).ToList();

      return nameTags;
    }

    void Borders(DataTree<object> param)
    {
      int[] fughe = param.Branch(param.BranchCount - 1)[0].ToString().Split('-')[2].Split('.').Select(element => Convert.ToInt32(element)).ToArray();

      PolylineCurve curve = (PolylineCurve)param.Branch(param.BranchCount - 1)[1];

      double[] x = new double[4];
      double[] y = new double[4];

      for (int i = 0; i < 4; i++)
      {
        x[i] = curve.Point(i).X;
        y[i] = curve.Point(i).Y;
      }

      yCoordinates.Insert(0, Math.Round(y.Min() + fughe[0]));
      xCoordinates.Insert(xCoordinates.Count, Math.Round(x.Max() - fughe[1]));
      yCoordinates.Insert(yCoordinates.Count, Math.Round(y.Max() - fughe[2]));
      xCoordinates.Insert(0, Math.Round(x.Min() + fughe[3]));
    }
  }

  public class PanelC41
  {
    //fields
    public double width;
    public double height;
    public double borderUp;
    public double borderDown;
    public double hookUp;
    public double hookDown;

    public Polyline pl;
    public bool crossed;
    public string name;

    //Constructor
    public PanelC41(List<Point3d> list, List<Polyline> obs)
    {
      borderUp = 0;
      borderDown = 0;
      hookUp = 0;
      hookDown = 0;

      pl = new Polyline(list);
      Intercept(obs);
      Name();
    }

    public void Intercept(List<Polyline> obs)
    {
      int a = 0;

      for (int i = 0; i < obs.Count; i++)
      {
        a += Intersection.CurveCurve(pl.ToPolylineCurve(), obs[i].ToPolylineCurve(), 0.1, 0.1).Count;
      }

      if (a == 0) crossed = false;
      else crossed = true;
    }

    public void Name()
    {
      width = Math.Round(pl[0].DistanceTo(pl[1]));
      height = Math.Round(pl[1].DistanceTo(pl[2]));
      name = width.ToString() + '-' + height.ToString();
    }
  }

  public List<string> Archive(List<PanelC41> panelC41s)
  {
    List<string> list;
    var orderedPanels = panelC41s.OrderBy(panelC41 => panelC41.width).ThenBy(panelC41 => panelC41.height);

    list = orderedPanels.Select(x => x.name).ToList();

    List<string> arc = new List<string> { list[0] };
    for (int i = 1; i < list.Count; i++)
    {
      if (list[i] != list[i - 1])
      {
        arc.Add(list[i]);
      }
    }

    return arc;
  }
# ---------- end c_script ----------
scriptpar = ScriptParasite(Enable=True, Folder="C:\Users\riccardo\source\repos\GH_Develop\AutoPanel")

# ---- group: OBSTACLE COLORS
cluster = Cluster(x=c_script.freeTag)
geo = Geometry(c_script.pl)
preview = CustomPreview(Geometry=geo, Material=cluster)

# ---- group: ACTIVATE
onoff = EnableDisableObject(Enabled=Toggle(False), AllObjects_Object=[layers, qb, textbaker])

# ----
layers = CreateModifyLayers(LayerName=c_script.archive, DeleteLayer=False, enableFullPath=False)  # -> LayerNames, LayerFullPath; disabled

# ---- group: VIEW
hideshow = HideShowObjectPreview(Visible=Toggle(True), AllObjects_Object=[preview, textbaker])

# ---- group: WIRE DISPLAY
list = ValueList({"def": 0, "fai": 1, "hid": 2}, selected="hid")
wiredisplay = ControlWireDisplay(WireDisplay=list, AllObjects_Object=[c_script, layers, qb, area, textbaker, python_2])

# ----
panel_4 = Panel("BAKING STATION")
bake = Button()

# ---- group: TEXT-DISPLAY
area = Area(Geometry=c_script.pl)  # -> Area, Centroid
python_2 = GhPythonScript(x=c_script.names)  # -> a
# ---------- python_2: Python ----------
__author__ = "riccardo"
__version__ = "2023.02.21"

import rhinoscriptsyntax as rs

a = '%' + x
# ---------- end python_2 ----------
textbaker = TextBaker(
    Location=area.Centroid,
    Text=c_script.names,
    Size="100",
    Attribute=python_2,
    Justification=4,
    Bake=bake,
    Dot_Text=False,
    Enable_Mask=True,
    On_Screen=False)  # disabled

# ----
qb = QuickBaker(Geometric=c_script.pl, Attribute=python_2, Bake=False)  # disabled

# ==== cluster Cluster
x = ClusterInput()
python = GhPythonScript(x=x)  # -> a
# ---------- python: Python ----------
__author__ = "riccardo"
__version__ = "2023.02.21"

import rhinoscriptsyntax as rs

if (x == False):
    a = '63,232,232'
else:
    a = '230,37,232'
# ---------- end python ----------
material = CreateMaterial(Diffuse=python, Specular=RGB(255, 255, 255), Emission=RGB(0, 0, 0), Transparency=0, Shine=0)
M = ClusterOutput(material)
