# Grasshopper definition AutoPanel3.gh (Grasshopper 1.0.7)
# plug-ins: ScriptParasite, EleFront, MetaHopper, Heteroptera, Human

layertable = LayerTable(Update=Button(), AutoUpdate=False)  # -> Layers, FullLayerPaths, LayerColors, Linetypes, MaterialNames, Visible, PrintWidth, PrintColor
python = GhPythonScript(x=layertable.Layers)  # -> flatten(a), flatten(b); inputs x: list
# ---------- python: Python ----------
__author__ = "riccardo"
__version__ = "2023.02.27"

import rhinoscriptsyntax as rs

list = []
list2 = []

for i in x:
    if (i.split('-')[0] == 'dir'):
        list.append(i)
    if (i.split('-')[0] == 'obs'):
        list2.append(i)

list.sort()

a = list
b = list2
# ---------- end python ----------
panel = Panel(python.a)
panel_2 = Panel("""Librerie aggiuntive:
Elefront
Human
MetaHopper
Heteroptera""")
# Ordine dei Layers da Rhino:
# 
# 'dir'   => PARENT LAYER
# -------------------
# > 'dir-border-h'  => 1 LINEA (BORDO H)
# > 'dir-border-v'  => 1 LINEA (BORDO V)
# 
# > 'dir-h-x.x'     => N LINEE (FUGHE H)
# > ...
# > 'dir-v-x.x'     => N LINEE (FUGHE V)
# > ...
# -------------------
# 
# 'obs'   => PARENT LAYER
# -------------------
# > obs-[...]       => N POLILINEE (OSTACOLI)
# > ...
# -------------------
counter = Counter()
panel_3 = Panel(python.b)

panel_4 = Panel("""dir-0border
dir-0h-2.2
dir-0h-8.8
dir-0v-8.8
dir-1border
dir-1h-2.2
dir-1h-8.8
dir-1v-8.8
dir-2border
dir-2h-2.2
dir-2h-8.8
dir-2v-8.8""")
panel_5 = Panel("CONTROLLO MANUALE LAYERS")

panel_6 = Panel("""obs-0windows
obs-0detach
obs-0pavement
obs-0other
obs-1windows
obs-1detach
obs-1pavement
obs-1other
obs-2windows
obs-2detach
obs-2pavement
obs-2other""")
reflay = ReferenceByLayer(LayerName=panel_6)  # -> simplify(Geometry)

reflay_2 = ReferenceByLayer(LayerName=panel_4)

# ---- group: H-V
c_script = CSharpScript(y=reflay_2)  # -> A; inputs y: tree of Polyline; disabled
# ---------- c_script: C# ----------
    Polyline h = (Polyline) y.Branch(0)[0];
    Polyline v = (Polyline) y.Branch(1)[0];

    bool a = false;

    double Y = h.PointAt(1).Y - h.PointAt(0).Y;
    double X = v.PointAt(1).X - v.PointAt(0).X;

    if ( Y != 0 || X != 0) a = true;

    if (a)
    {      
      A = "H o V non sono ortogonali";
    }
    else
    {
      A = "OK";
    }
# ---------- end c_script ----------
panel_7 = Panel(c_script)  # disabled

# ----
merge = Merge(Data1=graft(panel_4), Data2=reflay_2)  # -> simplify(Result)

# ---- group: BORDER LAYERS
c_script_2 = CSharpScript(y=merge)  # -> A; inputs y: tree; disabled
# ---------- c_script_2: C# ----------
    var a = (string) y.Branch(0)[0];
    var b = (string) y.Branch(1)[0];

    bool c = false;

    if ( a != "dir-border-h" || b != "dir-border-v") c = true;

    if (c)
    {
      A = "Problema con i due layer di bordo";
    }
    else
    {
      A = "OK";
    }
# ---------- end c_script_2 ----------
panel_8 = Panel(c_script_2)  # disabled

# ---- group: LAYER NAMES
c_script_3 = CSharpScript(y=merge)  # -> A; inputs y: tree; disabled
# ---------- c_script_3: C# ----------
    List<string> list = new List<string>();

    for (int i = 2; i < y.BranchCount; i++)
    {
      string k = y.Branch(i)[0].ToString().Split('-')[1];
      list.Add(k);
    }

    bool c = false;

    foreach (string i in list)
      if ( i != "h" && i != "v" && i != "b") c = true;

    if (c)
    {
      A = "Problema di nomenclatura con i layer delle griglie";
    }
    else
    {
      A = "OK";
    }
# ---------- end c_script_3 ----------
panel_9 = Panel(c_script_3)  # disabled

# ---- group: GENERATOR
c_script_4 = CSharpScript(x=merge, y=reflay)  # -> out, A, pl, layerNames, names, archive, freeTag, export, PanelC41; inputs x: tree, y: tree
# ---------- c_script_4: C# usings ----------
using Rhino.Geometry.Intersect;
using System.Linq;
using Rhino.DocObjects;
using Rhino.UI.Controls;
using Grasshopper.Kernel.Types.Transforms;
using System.Diagnostics;
# ---------- c_script_4: C# ----------
    facade = new Facade(x, y);

    panelC41s = new List<PanelC41>();
    plines = new DataTree<Polyline>();
    this.archive = new List<string>();
    this.names = new DataTree<string>();
    toExport = new List<string>();
    normals = new List<Vector3d>();

    foreach (Grid3d grid in facade.grids)
    {
      int i = facade.grids.IndexOf(grid);
      panelC41s.AddRange(grid.panels);
      plines.AddRange(grid.Plines(grid.panels), new GH_Path(i));
      this.names.AddRange(grid.NameTags(grid.panels), new GH_Path(i));
      toExport.AddRange(grid.ToExport(grid.panels));
      normals.Add(grid.normal);
    }
    this.archive.AddRange(ArchiveTypes(panelC41s));

    pl = plines;
    //layerNames = facade.grids[0].TypeTags(panelC41s);
    names = this.names;
    archive = this.archive;
    //freeTag = facade.grids[0].FreeTag(panelC41s);
    export = toExport;
    PanelC41 = normals;
# ---------- c_script_4: C# additional code ----------
  // fields
  public Facade facade;
  public List<PanelC41> panelC41s;
  public DataTree<Polyline> plines;
  public DataTree<string> names;
  public List<string> toExport;
  public List<Vector3d> normals;

  public List<string> archive;

  public class Facade
  {
    //fields
    public List<Grid3d> grids;
    public DataTree<PanelC41> panelsTree;
    List<int> gridCount;

    //contructor
    public Facade(DataTree<object> input, DataTree<object> obs)
    {
      grids = new List<Grid3d>();
      panelsTree = new DataTree<PanelC41>();
      gridCount = new List<int>();

      var counter = FacadeCount(input);
      var pointer = 0;

      for (int i = 0; i < counter.Count; i++)
      {
        DataTree<object> tmp = new DataTree<object>();
        DataTree<object> tmpObs = new DataTree<object>();
        var count = 0;

        for (int j = pointer; j < pointer + counter[i]; j++)
        {
          tmp.AddRange(input.Branch(j), new GH_Path(count)); count++;
        }
        pointer += counter[i];

        var k = i * 4;
        count = 0;
        for (int j = k; j < k + 4; j++)
        {
          tmpObs.AddRange(obs.Branch(j), new GH_Path(count));
          count++;
        }

        Grid3d tmpGrid = new Grid3d(tmp, tmpObs);
        grids.Add(tmpGrid);
        //panelsTree.AddRange(tmpGrid.panels, new GH_Path(i - 1));
      }

      gridCount = counter;
    }

    public List<int> FacadeCount(DataTree<object> input)
    {
      List<int> k = new List<int> { 1 };
      List<double> compare = new List<double>();

      for (int i = 0; i < input.BranchCount; i++)
      {
        double a = char.GetNumericValue(input.Branch(i)[0].ToString().Split('-')[1][0]);
        compare.Add(a);
      }

      for (int i = 1; i < compare.Count; i++)
      {
        if (compare[i] == compare[i - 1]) k[k.Count - 1]++;
        else k.Add(1);
      }

      return k;
    }
  }

  public class Grid3d
  {
    DataTree<object> param;
    public DataTree<Polyline> obs;

    public Polyline border;
    public Polyline height;
    public Vector3d normal;

    // tutte le coordinate delle fughe in X e Z
    List<Point3d> pointCoordinates;
    List<double> zCoordinates;

    public List<PanelC41> panels;
    public List<Point3d> pts;

    public Grid3d(DataTree<object> x, DataTree<object> y)
    {
      param = x;
      obs = new DataTree<Polyline>();

      for (int i = 0; i < y.BranchCount; i++)
      { obs.AddRange(y.Branch(i).Select(pl => (PolylineCurve)pl).ToList().Select(pl => pl.ToPolyline()).ToList(), new GH_Path(i)); }

      BorderRotation(x.Branch(0)[1]);
      OrderLines(param);

      pts = new List<Point3d>();

      panels = Panels(pointCoordinates, zCoordinates);

      OrderOutput(panels);

      PostPanels(panels);
    }

    public void BorderRotation(object a)
    {
      PolylineCurve p = (PolylineCurve)a;
      Polyline tmpPl = p.ToPolyline();
      List<Point3d> list = tmpPl.Select(point => point).ToList();
      list.RemoveAt(list.Count - 1);
      list.OrderBy(point => point.Z).ThenBy(point => point.X);

      border = new Polyline(list.GetRange(0, 2));
      height = new Polyline(new List<Point3d> { list[3], list[0] });

      normal = Vector3d.CrossProduct(new Vector3d(border[1]- border[0]), new Vector3d(height[0]- height[1]));
    }

    public void OrderLines(DataTree<object> param)
    {
      List<double> xtmp = new List<double>();
      List<Point3d> ptmp = new List<Point3d>();
      List<double> ztmp = new List<double>();

      // i = 1 perché il primo è il bordo
      for (int i = 1; i < param.BranchCount; i++)
      {
        int fuga = (int)Convert.ToInt64(param.Branch(i)[0].ToString().Split('-')[2].ToString().Split('.')[0]);
        char dir = param.Branch(i)[0].ToString().Split('-')[1][1];

        List<Point3d> tmpP = new List<Point3d>();

        if (dir == 'h')
        {
          // start at j = 1 perchè la prima linea è il nome del layer 
          for (int j = 1; j < param.Branch(i).Count; j++)
          {
            PolylineCurve tmpPl = (PolylineCurve)param.Branch(i)[j];
            ztmp.Add(tmpPl.PointAt(0).Z - fuga);
            ztmp.Add(tmpPl.PointAt(0).Z + fuga);
          }
        }

        else if (dir == 'v')
        {
          // start at j = 1 perchè la prima linea è il nome del layer
          for (int j = 1; j < param.Branch(i).Count; j++)
          {
            PolylineCurve tmpPl = (PolylineCurve)param.Branch(i)[j];
            Point3d tmpPoint = tmpPl.PointAtStart;
            Point3d tp = new Point3d(tmpPl.PointAt(0).X, tmpPl.PointAt(0).Y, border.PointAt(0).Z);
            Circle c = new Circle(tp, fuga);
            var events = Intersection.CurveCurve(border.ToNurbsCurve(), c.ToNurbsCurve(), 0.1, 0.1);
            foreach (IntersectionEvent ie in events) { tmpP.Add(new Point3d(ie.PointA)); }
          }

          ptmp.AddRange(tmpP);
        }
      }

      ztmp.Sort();
      ztmp.RemoveAt(0);
      ztmp.RemoveAt(0);
      ztmp.RemoveAt(ztmp.Count - 1);
      ztmp.RemoveAt(ztmp.Count - 1);
      double[] t = new double[] { height[0].Z, height[1].Z };
      ztmp.Insert(0, t.Min());
      ztmp.Add(t.Max());

      if (Math.Abs(border[1].X - border[0].X) > 0.01)
      {
        ptmp = ptmp.OrderBy(point => point.X).ToList();
        ptmp.RemoveAt(0);
        ptmp.RemoveAt(ptmp.Count - 1);
        ptmp.AddRange(new List<Point3d> { border.PointAt(0), border.PointAt(1) });

        pointCoordinates = ptmp.OrderBy(point => point.X).ToList();
      }
      else
      {
        ptmp = ptmp.OrderBy(point => point.Y).ToList();
        ptmp.RemoveAt(0);
        ptmp.RemoveAt(ptmp.Count - 1);
        ptmp.AddRange(new List<Point3d> { border.PointAt(0), border.PointAt(1) });

        pointCoordinates = ptmp.OrderBy(point => point.Y).ToList();
      }

      zCoordinates = ztmp;
    }

    public List<PanelC41> Panels(List<Point3d> pointCoordinates, List<double> zCoordinates)
    {
      List<PanelC41> panels = new List<PanelC41>();

      for (int i = 0; i < zCoordinates.Count; i += 2)
      {
        for (int j = 0; j < pointCoordinates.Count; j += 2)
        {
          var points = new List<Point3d> {
                new Point3d(pointCoordinates[j].X, pointCoordinates[j].Y, zCoordinates[i]),
                new Point3d(pointCoordinates[j + 1].X, pointCoordinates[j + 1].Y, zCoordinates[i]),
                new Point3d(pointCoordinates[j + 1].X, pointCoordinates[j + 1].Y, zCoordinates[i + 1]),
                new Point3d(pointCoordinates[j].X, pointCoordinates[j].Y, zCoordinates[i + 1]),
                new Point3d(pointCoordinates[j].X, pointCoordinates[j].Y, zCoordinates[i])
            };

          pts.AddRange(points.GetRange(0, 4));

          PanelC41 tmpPanel = new PanelC41(points, obs);
          if (!tmpPanel.crossed) panels.Add(tmpPanel);
        }
      }

      return panels;
    }

    public void OrderOutput(List<PanelC41> panels)
    {
      List<PanelC41> tmp;
      if (Math.Abs(border[1].X - border[0].X) > 0.01)
      {
        tmp = panels.OrderBy(a => a.firstCorner[0]).ThenBy(b => b.firstCorner[2]).ToList();
      }
      else
      {
        tmp = panels.OrderBy(a => a.firstCorner[1]).ThenBy(b => b.firstCorner[2]).ToList();
      }
      this.panels.Clear();

      this.panels.AddRange(tmp);
    }

    void PostPanels(List<PanelC41> panels)
    {
      for (int i = 0; i < panels.Count - 1; i++)
      {
        if (panels[i].type == "B" || panels[i].type == "B*C")
        {
          if (panels[i + 1].type == "C") panels[i + 1].type = "D*C";
          else panels[i + 1].type = "D";
        }
      }
    }

    public List<Polyline> Plines(List<PanelC41> panels)
    {
      List<Polyline> polylines = panels.Select(i => i.pl).ToList();

      return polylines;
    }

    public List<bool> FreeTag(List<PanelC41> panels)
    {
      List<bool> freeTag = panels.Select(i => i.crossed).ToList();

      return freeTag;
    }

    public List<string> DimensionsTags(List<PanelC41> panels)
    {
      List<string> nameTags = panels.Select(i => i.name).ToList();

      return nameTags;
    }

    public List<string> NameTags(List<PanelC41> panels)
    {
      List<string> names = panels.Select(i => i.type).ToList();
      for (int i = 0; i < panels.Count; i++)
      {
        names[i] = names[i] + "|" + panels[i].name;
      }

      return names;
    }

    public List<string> TypeTags(List<PanelC41> panels)
    {
      List<string> types = panels.Select(i => i.type).ToList();

      return types;
    }

    public List<string> ToExport(List<PanelC41> panels)
    {
      List<string> export = panels.Select(i => i.toExcel).ToList();
      export.Insert(0, "Type,Width,Heigh,Marca");

      return export;
    }

  }

  public class PanelC41
  {
    //fields
    public double width;
    public double height;
    public double borderUp;
    public double borderDown;
    public double hookUp;
    public double hookDown;

    public Polyline pl;
    public bool crossed;
    public string type;
    public string name;
    public double[] firstCorner = new double[3];

    public string toExcel;

    //Constructor
    public PanelC41(List<Point3d> list, DataTree<Polyline> obs)
    {
      borderUp = 1;
      borderDown = 2;
      hookUp = 3;
      hookDown = 4;
      type = "A";

      crossed = false;

      pl = new Polyline(list);
      firstCorner[0] = pl[0].X;
      firstCorner[1] = pl[0].Y;
      firstCorner[2] = pl[0].Z;

      int[] i = Intercept(obs);

      if (i[0] >= 0)
      {
        crossed = InterceptedPanelVertical(obs.Branch(0), i[0], 8);
      }
      if (i[1] >= 0)
      {
        crossed = InterceptedPanelHorizontal(obs.Branch(2), i[1], 8);
      }

      Name();
      Detached(obs.Branch(1));
      InterceptedPanelVarious(obs.Branch(3));

      toExcel = type + "," + width.ToString() + "," + height.ToString() +
        "," + type + "." + width.ToString() + "." + height.ToString();
    }

    public PanelC41(List<Point3d> list)
    {
      borderUp = 1;
      borderDown = 2;
      hookUp = 3;
      hookDown = 4;
      type = "A";

      crossed = false;

      pl = new Polyline(list);
      firstCorner[0] = pl[0].X;
      firstCorner[1] = pl[0].Y;

      Name();

      toExcel = type + "," + width.ToString() + "," + height.ToString() +
        "," + type + "." + width.ToString() + "." + height.ToString();
    }

    public int[] Intercept(DataTree<Polyline> obs)
    {
      // ora non funziona per ostacoli multipli che intersecano oggetti
      int b = -1;
      int c = -1;

      // Branch(0) windows. Polylines centrate sul pannello verticalmente
      for (int i = 0; i < obs.Branch(0).Count; i++)
      {
        var tmp = Intersection.CurveCurve(pl.ToPolylineCurve(), obs.Branch(0)[i].ToPolylineCurve(), 0.1, 0.1).Count;
        //counter += tmp;
        if (tmp != 0) b = i;
      }

      // Branch(2) pavements. Polylines centrate sul pannello orizzontalmente
      for (int i = 0; i < obs.Branch(2).Count; i++)
      {
        var tmp = Intersection.CurveCurve(pl.ToPolylineCurve(), obs.Branch(2)[i].ToPolylineCurve(), 0.1, 0.1).Count;
        //counter += tmp;
        if (tmp != 0) c = i;
      }

      if (b < 0 && c < 0) crossed = false;
      else crossed = true;
      return new int[] { b, c };
    }

    public void Name()
    {
      width = Math.Round(pl[0].DistanceTo(pl[1]));
      height = Math.Round(pl[1].DistanceTo(pl[2]));
      name = width.ToString() + '-' + height.ToString();
    }

    public bool InterceptedPanelVertical(List<Polyline> obs, int i, double fuga)
    {
      // Funziona solo per finestre centrate sui pannelli
      // Viene considerata solo la Z quindi

      double[] zObs = new double[] { obs[i][0].Z, obs[i][1].Z, obs[i][2].Z };
      double[] z = new double[] { pl[0].Z, pl[1].Z, pl[2].Z };

      if (zObs.Max() >= z.Max() && zObs.Min() <= z.Min())
      {
        return true;
      }
      else if (z.Max() > zObs.Max())
      {
        double newZ = zObs.Max();
        List<Point3d> tmp = new List<Point3d>()
        {
          new Point3d(pl[0].X, pl[0].Y, newZ+ fuga),
          new Point3d(pl[1].X, pl[1].Y, newZ+ fuga),
          new Point3d(pl[2]),
          new Point3d(pl[3]),
          new Point3d(pl[4].X, pl[4].Y, newZ+ fuga),
        };

        pl = new Polyline(tmp);
        return false;
      }
      else if (z.Min() < zObs.Min())
      {
        double newZ = zObs.Min();
        List<Point3d> tmp = new List<Point3d>()
        {
          new Point3d(pl[0]),
          new Point3d(pl[1]),
          new Point3d(pl[2].X, pl[2].Y, newZ - fuga),
          new Point3d(pl[3].X, pl[3].Y, newZ - fuga),
          new Point3d(pl[4]),
        };

        pl = new Polyline(tmp);

        return false;
      }

      else { return false; }
    }

    public bool InterceptedPanelHorizontal(List<Polyline> obs, int i, double fuga)
    {
      // Funziona solo per rettangoli orizzontali centrati sui pannelli
      // Viene considerata solo X-Y quindi

      List<Point3d> p = new List<Point3d> { pl[0], pl[1] };
      List<Point3d> pObs = new List<Point3d> { obs[i][0], obs[i][1], obs[i][2], obs[i][3] };
      pObs.OrderBy(point => point.Z);
      pObs.RemoveRange(2, 2);

      double[] compare = new double[4];

      if (Math.Abs(pl[1].X - pl[0].X) > 0.01)
      {
        pObs.OrderBy(point => point.X);
        compare = new double[] { pl[0].X, pl[1].X, pObs[0].X, pObs[1].X };
      }
      else
      {
        pObs.OrderBy(point => point.Y);
        compare = new double[] { pl[0].Y, pl[1].Y, pObs[0].Y, pObs[1].Y };
      }

      // Obs bigger
      if (compare[3] >= compare[1] && compare[2] <= compare[0])
      {
        return true;
      }
      // Obs from the left
      else if (compare[1] > compare[3])
      {
        //double newX = xObs.Max();
        List<Point3d> tmp = new List<Point3d>()
        {
          new Point3d(pObs[1].X, pObs[1].Y, pl[0].Z),
          new Point3d(pl[1]),
          new Point3d(pl[2]),
          new Point3d(pObs[1].X, pObs[1].Y, pl[3].Z),
          new Point3d(pObs[1].X, pObs[1].Y, pl[4].Z)
        };

        pl = new Polyline(tmp);
        return false;
      }
      // Obs from the right
      else if (compare[0] < compare[2])
      {
        //double newX = xObs.Min();
        List<Point3d> tmp = new List<Point3d>()
        {
          new Point3d(pl[0]),
          new Point3d(pObs[0].X, pObs[0].Y, pl[1].Z),
          new Point3d(pObs[0].X, pObs[0].Y, pl[2].Z),
          new Point3d(pl[3]),
          new Point3d(pl[0])
        };

        pl = new Polyline(tmp);

        return false;
      }

      else { return false; }
    }

    public void InterceptedPanelVarious(List<Polyline> obs)
    {
      int counter = 0;
      double yAxe = Math.Abs(pl[1].X - pl[0].X);
      double[] h;

      if (yAxe > 0.01)
      {
        h = new double[] { pl[0].X, pl[1].X };
      }
      else
      {
        h = new double[] { pl[0].Y, pl[1].Y };
      }

      double[] z = new double[] { pl[1].Z, pl[2].Z };

      for (int i = 0; i < obs.Count; i++)
      {
        // Pannelli intersecati da un ostacolo
        var tmp = Intersection.CurveCurve(pl.ToPolylineCurve(), obs[i].ToPolylineCurve(), 0.1, 0.1).Count;
        counter += tmp;
        double[] hObs;
        if (yAxe > 0.01)
        {
          hObs = new double[] { obs[i][0].X, obs[i][1].X };
        }
        else
        {
          hObs = new double[] { obs[i][0].Y, obs[i][1].Y };
        }

        double[] zObs = new double[] { obs[i][1].Z, obs[i][2].Z };

        // Pannelli C circondati
        if (hObs[1] > h[1] && h[0] > hObs[0] && zObs[1] > z[1] && z[0] > zObs[0])
        {
          counter++;
          crossed = true;
        }

        // Pannelli C con un foro
        if (hObs[1] < h[1] && h[0] < hObs[0] && zObs[1] < z[1] && z[0] < zObs[0]) counter++;
      }

      if (counter > 0)
      {
        if (type == "A") type = "C";
        else type += "*C";
      }
    }

    public void Detached(List<Polyline> det)
    {
      // Per ogni Line di intersezione 

      int counter = 0;

      for (int i = 0; i < det.Count; i++)
      {
        var tmp = Intersection.CurveCurve(pl.ToPolylineCurve(), det[i].ToPolylineCurve(), 0.1, 0.1).Count;
        counter += tmp;
      }

      if (counter != 0)
      {
        type = "B";
      }
    }
  }

  public List<string> ArchiveDimensions(List<PanelC41> panelC41s)
  {
    List<string> list;
    var orderedPanels = panelC41s.OrderBy(panelC41 => panelC41.width).ThenBy(panelC41 => panelC41.height);

    list = orderedPanels.Select(x => x.name).ToList();

    List<string> arc = new List<string> { list[0] };
    for (int i = 1; i < list.Count; i++)
    {
      if (list[i] != list[i - 1])
      {
        arc.Add(list[i]);
      }
    }

    return arc;
  }

  public List<string> ArchiveTypes(List<PanelC41> panelC41s)
  {
    List<string> list;
    var orderedPanels = panelC41s.OrderBy(panelC41 => panelC41.type);

    list = orderedPanels.Select(x => x.type).ToList();

    List<string> arc = new List<string> { list[0] };
    for (int i = 1; i < list.Count; i++)
    {
      if (list[i] != list[i - 1])
      {
        arc.Add(list[i]);
      }
    }

    return arc;
  }
# ---------- end c_script_4 ----------
scriptpar = ScriptParasite(Enable=True, Folder="C:\Users\riccardo\source\repos\GH_Develop\AutoPanel")

# ---- group: PANEL NAMES
c_script_5 = CSharpScript(x=c_script_4.layerNames, y=c_script_4.names, z=c_script_4.PanelC41)  # -> A; inputs x: list of String, y: list of String, z: list; disabled
# ---------- c_script_5: C# ----------
    if (x.Count == y.Count && y.Count == z.Count)
    {
      List<string> k = new List<string>();

      bool c = false;

      for (int i = 0; i < x.Count; i++)
      {
        if (x[i] != y[i].Split('|')[0]) c = true;

        k.Add(x[i] + y[i].Split('|')[0]);
      }

      if (c)
      {
        A = "Problema di nomenclatura dei pannelli";
      }
      else
      {
        A = "OK";
      }
    }
    else
    {
      A = "Le tre liste non hanno lo stesso numero di oggetti";
    }
# ---------- end c_script_5 ----------
panel_10 = Panel(c_script_5)  # disabled

# ---- group: HATCH COLORS
swatch = ColourSwatch(SwatchColor=RGB(242, 68, 68))
swatch_2 = ColourSwatch(SwatchColor=RGB(100, 217, 121))
swatch_3 = ColourSwatch(SwatchColor=RGB(224, 151, 61))
swatch_4 = ColourSwatch(SwatchColor=RGB(227, 208, 61))
swatch_5 = ColourSwatch(SwatchColor=RGB(82, 137, 227))
swatch_6 = ColourSwatch(SwatchColor=RGB(186, 77, 219))
panel_11 = Panel(c_script_4.archive)

# ---- group: PRODUCTION CHECK
c_script_6 = CSharpScript(x=c_script_4.pl, y=c_script_4.names)  # -> A; inputs x: list of Polyline, y: list of String
# ---------- c_script_6: C# usings ----------
using System.Linq;
# ---------- c_script_6: C# ----------
    alert.Clear();

    if (x.Count == y.Count)
    {
      for (int i = 0; i < x.Count; i++)
      {
        Check(x[i], y[i]);
      }
    }

    A = alert;
# ---------- c_script_6: C# additional code ----------
  // START CODE

  List<Point3d> alert = new List<Point3d>();

  public void Check(Polyline pl, string name)
  {
    string type = name.Split('|')[0];
    double len;
    double tolerance;

    if (type == "A")
    {
      tolerance = 90;
      len = pl[0].DistanceTo(pl[1]);
      double test = len + tolerance;

      if (test > 1250)
      {
        alert.Add(new Point3d(pl.BoundingBox.Center));
      }
    }
  }

  // END CODE
# ---------- end c_script_6 ----------
scriptpar_2 = ScriptParasite(Enable=True, Folder="C:\Users\riccardo\source\repos\GH_Develop\AutoPanel")

# ---- group: PRODUCTION
cir = Circle(Plane=c_script_6, Radius=100)  # disabled

# ----
bake_hatch_colors = Button()  # disabled
bake_hatch_grey = Button()  # disabled
panel_12 = Panel("BAKING STATION")  # disabled
bake_polylines = Button()  # disabled
bake_texts = Button()

# ---- group: XLS
xlsx = Button()  # disabled
f_ghfilepath = GHFilePathInfo()  # -> F, P; disabled
# ---------- f_ghfilepath: C# ----------
                                      /*
    froGH - a sparse collection of (in)utilities for Grasshopper

    GH File and Path info

    code by Alessio Erioli

    froGH by Co-de-iT is licensed under a Creative Commons Attribution 4.0 International License.
    http://creativecommons.org/licenses/by/4.0/

    */

    initComp();

    GH_Document ghDoc = Grasshopper.Instances.ActiveCanvas.Document;

    int nameLen = ghDoc.DisplayName.TrimEnd('*').Length + 3; // +3 accounts for the '.gh' extension
    int fileLen = ghDoc.FilePath.TrimEnd('*').Length;

    F = ghDoc.DisplayName.TrimEnd('*');
    P = ghDoc.FilePath.Substring(0, fileLen - nameLen);
# ---------- f_ghfilepath: C# additional code ----------
  void initComp(){

    Component.Name = "GH File Path Info";
    Component.NickName = "f_GHFilePath";
    Component.Description = "Provides info on current Grasshopper Document file name and path\nUseful for exporting files with the same name as the gh file and in the same directory";
    Component.Params.Output[0].Name = "File Name";
    Component.Params.Output[0].Description = "Current GH file name";
    Component.Params.Output[1].Name = "File Path";
    Component.Params.Output[1].Description = "Current GH file path";
  }
# ---------- end f_ghfilepath ----------
python_2 = GhPythonScript(x=f_ghfilepath.P, y=c_script_4.export, z=xlsx)  # -> out, a; inputs y: list, z: Boolean; disabled
# ---------- python_2: Python ----------
__author__ = "riccardo"
__version__ = "2023.02.23"

import os
import rhinoscriptsyntax as rs

def Database():
    # Get Path in the document
    filePathXlsx = os.path.join(x, 'database' + '.xlsx')
    
    txt = ''
    
    for i in y:
        txt += i
        txt += '\n'
    
    #Write to .xlsx
    file = open(filePathXlsx, "w")
    file.write(txt[0:len(txt)-1])
    file.close()
    
    return txt

if (z):
    a = Database()
# ---------- end python_2 ----------

# ---- group: VIEW
toggle = BooleanToggle(True)

# ---- group: ACTIVATE BAKING
toggle_2 = BooleanToggle(False)  # disabled

# ---- group: WIRE DISPLAY
list = ValueList({"def": 0, "fai": 1, "hid": 2}, selected="hid")  # disabled

# ----
wiredisplay = ControlWireDisplay(WireDisplay=list)  # disabled
hideshow = HideShowObjectPreview(Visible=toggle, AllObjects_Object=[preview, textbaker_2])
onoff = EnableDisableObject(Enabled=toggle_2)  # disabled

area = Area(Geometry=c_script_4.pl)  # -> Area, Centroid
pl = PlaneNormal(Origin=area.Centroid, ZAxis=graft(c_script_4.PanelC41))
python_3 = GhPythonScript(x=pl)  # -> a; inputs x: Plane
# ---------- python_3: Python ----------
__author__ = "riccardo"
__version__ = "2023.03.01"

import rhinoscriptsyntax as rs
import math

if (x.YAxis.Z < 0):
    x.Rotate(math.pi, x.ZAxis, x.Origin)
    a = x

else:
    a = x
# ---------- end python_3 ----------

# ---- group: POLYLINES
python_4 = GhPythonScript(x=c_script_4.layerNames)  # -> a; disabled
# ---------- python_4: Python ----------
__author__ = "riccardo"
__version__ = "2023.02.21"

import rhinoscriptsyntax as rs

a = '%' + x
# ---------- end python_4 ----------
qb = QuickBaker(Geometric=c_script_4.pl, Attribute=python_4, Bake=bake_polylines)  # disabled

# ---- group: LAYERS
python_5 = GhPythonScript(x=c_script_4.archive)  # -> a; inputs x: list; disabled
# ---------- python_5: Python ----------
__author__ = "riccardo"
__version__ = "2023.02.24"

import rhinoscriptsyntax as rs

#x.append('hatch_grey')
#x.append('hatch_colors')

a = x
# ---------- end python_5 ----------
layers = CreateModifyLayers(LayerName=python_5, DeleteLayer=False, enableFullPath=False)  # -> LayerNames, LayerFullPath; disabled

# ---- group: HATCH GREY
cluster = Cluster_2(B=bake_hatch_grey, C=c_script_4.pl)  # disabled

# ---- group: TEXT-BAKE
textbaker = TextBaker(
    Location=python_3,
    Text=c_script_4.names,
    Size="100",
    Attribute="%text",
    Justification=4,
    Bake=bake_texts,
    Dot_Text=False,
    Enable_Mask=True,
    On_Screen=False)  # disabled

# ---- group: OBSTACLE COLORS
cluster_2 = Cluster(x=c_script_4.freeTag)
preview = CustomPreview(Geometry=c_script_4.pl, Material=cluster_2)

# ---- group: HATCH COLORS
cluster_3 = Cluster_3(
    B=bake_hatch_colors,
    x=c_script_4.layerNames,
    C=c_script_4.pl,
    _0=swatch,
    _1=swatch_2,
    _2=swatch_3,
    _3=swatch_4,
    _4=swatch_5,
    _5=swatch_6)  # disabled

# ---- group: TEXT-DISPLAY
textbaker_2 = TextBaker(
    Location=python_3,
    Text=c_script_4.names,
    Size="100",
    Justification=4,
    Bake=False,
    Dot_Text=False,
    Enable_Mask=True,
    On_Screen=False)

# ==== cluster Cluster
x = ClusterInput()
python = GhPythonScript(x=x)  # -> a
# ---------- python: Python ----------
__author__ = "riccardo"
__version__ = "2023.02.21"

import rhinoscriptsyntax as rs

if (x == False):
    a = '63,232,232'
else:
    a = '230,37,232'
# ---------- end python ----------
material = CreateMaterial(Diffuse=python, Specular=RGB(255, 255, 255), Emission=RGB(0, 0, 0), Transparency=0, Shine=0)
M = ClusterOutput(material)

# ==== cluster Counter
button = Button()
button_2 = Button()
_0 = Button()
c_script = CSharpScript(x=button, y=button_2, z=_0, u=Slider(581, range=0..1000))  # -> A; inputs x: Boolean, y: Boolean, z: Boolean, u: Int32
# ---------- c_script: C# ----------
        if(x) a++;
    if(y) a--;
    if (z) a = 0;

    A = a+u;
# ---------- c_script: C# additional code ----------
  int a = 0;
# ---------- end c_script ----------
panel = Panel(c_script)

# ==== cluster Cluster_2
B = ClusterInput()
C = ClusterInput()
createatts = CreateAttributes(LayerName="hatch_grey", Color=ColourSwatch(SwatchColor=RGB(181, 181, 181)), enableFullPath=False)
createhatch = CreateHatch(Bake=B, Curves=C, HatchPatternName="Solid", HatchScale=1, HatchRotation=0, Attributes=createatts)  # -> HatchGeometry, HatchObjects

# ==== cluster Cluster_3
_0 = ClusterInput()
_1 = ClusterInput()
_2 = ClusterInput()
_3 = ClusterInput()
_4 = ClusterInput()
_5 = ClusterInput()
x = ClusterInput()
B = ClusterInput()
C = ClusterInput()
python = GhPythonScript(x=x)  # -> graft(a); inputs x: list
# ---------- python: Python ----------
__author__ = "riccardo"
__version__ = "2023.02.24"

import rhinoscriptsyntax as rs

list = []

for i in x:
    if (i == 'A'):
        list.append(0)
    if (i == 'B'):
        list.append(1)
    if (i == 'B*C'):
        list.append(2)
    if (i == 'C'):
        list.append(3)
    if (i == 'D'):
        list.append(4)
    if (i == 'D*C'):
        list.append(5)

a = list
# ---------- end python ----------
weave = Weave(Pattern=python, Stream0=_0, Stream1=_1, Stream2=_2, Stream3=_3, Stream4=_4, Stream5=_5, NullGaps=False)  # -> flatten(Weave)
createatts = CreateAttributes(LayerName="hatch_colors", Color=weave, enableFullPath=False)
createhatch = CreateHatch(Bake=B, Curves=C, HatchPatternName="Solid", HatchScale=1, HatchRotation=0, Attributes=createatts)  # -> HatchGeometry, HatchObjects
